# Grasshopper definition FloorPlanGH.gh (Grasshopper 1.0.7)
# plug-ins: treesloth01, TT Toolbox

boolean_toggle = BooleanToggle(False)  # disabled
read_excel_sheet = ReadExcelSheet(Run=boolean_toggle, Worksheet="1", Listen=boolean_toggle)  # -> UserMessages, Columns, Rows; disabled
text = Text(Tree({1}: ["Área de control vehicular - Vigilancia", "1", "1.5", "1.5", "1"], {2}: ["Parqueaderos vehicular (5,00 x 2,50 mts)", "5", "12.5", "62.5", "1"], {3}: ["Parqueaderos discapacitados (5,00 x 3,70 mts)", "1", "18.5", "18.5", "1"], {4}: ["Parqueaderos bicicletas/motos", "5", "1.2", "6", "1"], {5}: ["Zona de Parqueo ambulancias", "1", "11", "11", "1"], {6}: ["*", "*", "*", "*", ""]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))
partitiontreeatchar = CSharpScript(data=text, erase="*")  # -> A; inputs data: tree of String, erase: String
# ---------- partitiontreeatchar: C# ----------
    var treeOut = new DataTree<string>();
    int path = 0;

    for( int i = 0; i < data.BranchCount; ++i )
      for( int j = 0; j < data.Branch(i).Count; ++j )
      {

        if( data.Branch(i)[j] != erase )
        {

          treeOut.Add(data.Branch(i)[j], new GH_Path(path));
          //path++;

        }
        
        else
        {
        
          path++;
        
        }

      }

    A = treeOut;
# ---------- end partitiontreeatchar ----------
panel = Panel(partitiontreeatchar)
cleantreefromempty = CSharpScript(data=partitiontreeatchar)  # -> A; inputs data: tree of String
# ---------- cleantreefromempty: C# ----------
    var treeOut = new DataTree<string>();

    foreach( var path in data.Paths )
    {
    
      var branch = data.Branch(path);
      
      foreach( var item in branch )
      {
      
        if( !String.IsNullOrEmpty(item) )
        treeOut.Add( item, path );
      
      }
    
    }

    A = treeOut;
# ---------- end cleantreefromempty ----------
renumber_paths = RenumberPaths(Data=cleantreefromempty)
partition_list = PartitionList(List=renumber_paths, Size=Slider(5, range=0..10))
text_2 = Text(partition_list)
list_item = ListItem(List=text_2, Index=Slider(2, range=0..3), Wrap=True)
list_item_2 = ListItem(List=text_2, Index=Slider(3, range=0..3), Wrap=True)
list_item_3 = ListItem(List=text_2, Index=Slider(1, range=0..1), Wrap=True)
flatten_tree = FlattenTree(Tree=list_item_2, Path="{0}")
path_mapper = PathMapper(list_item, source="{A;B}", target="{A}")
mass_addition = MassAddition(Input=flatten_tree)  # -> Result, PartialResults
multiplication = Multiplication(A=path_mapper, B=0.5)
path_mapper_2 = PathMapper(list_item_3, source="{A;B}", target="{A}")
square_root = SquareRoot(Value=mass_addition.Result)
mass_addition_2 = MassAddition(Input=path_mapper_2)  # -> Result, PartialResults
branchcount = CSharpScript(x=path_mapper_2)  # -> A; inputs x: tree of String
# ---------- branchcount: C# ----------
    A = x.BranchCount;
# ---------- end branchcount ----------
multiplication_2 = Multiplication(A=square_root, B=0.5)
construct_domain = ConstructDomain(DomainStart=expr("-x", multiplication), DomainEnd=multiplication)
number_slider = Slider(10000, range=0..10000)
multiplication_3 = Multiplication(A=multiplication_2, B=Slider(1.9389, range=0..10))
random = Random(Range=Domain(0, 10000), Number=branchcount, Seed=Slider(6315, range=0..10000))  # -> graft(Random)
construct_domain_2 = ConstructDomain(DomainStart=expr("-x", multiplication_3), DomainEnd=multiplication_3)
rectangle = Rectangle(Plane=PlaneXY(0, 0, 0), XSize=construct_domain_2, YSize=construct_domain_2, Radius=0)  # -> Rectangle, Length
populate_2d = Populate2D(Region=rectangle.Rectangle, Count=mass_addition_2.Result, Seed=random)  # -> simplify(Population)
rectangle_2 = Rectangle(Plane=populate_2d, XSize=construct_domain, YSize=construct_domain, Radius=0)  # -> Rectangle, Length
list_length = ListLength(List=rectangle_2.Rectangle)
surface = Surface(rectangle.Rectangle)
random_2 = Random(Range=Domain(0, 1), Number=branchcount, Seed=Slider(465, range=0..1000))
random_3 = Random(Range=Domain(0, 1), Number=branchcount, Seed=Slider(460, range=0..1000))
random_4 = Random(Range=Domain(0, 1), Number=branchcount, Seed=Slider(342, range=0..1000))
evaluate_surface = EvaluateSurface(Surface=surface)  # -> Point, Normal, UDirection, VDirection, Frame
surface_2 = Surface(rectangle_2.Rectangle)
colour_rgb_f = ColourRGBF(Alpha=1, Red=random_2, Green=random_3, Blue=random_4)  # -> simplify(graft(Colour))
custom_preview = CustomPreview(Geometry=surface_2, Material=colour_rgb_f)
explode_tree = ExplodeTree(Data=colour_rgb_f)  # -> Branch0, Branch1, Branch2, Branch3, Branch4, Branch5, Branch6, Branch7, Branch8
explode_tree_2 = ExplodeTree(Data=rectangle_2.Rectangle)  # -> Branch0, Branch1, Branch2, Branch3, Branch4, Branch5, Branch6, Branch7, Branch8
geometry = Geometry(explode_tree_2.Branch0)
surface_3 = Surface(explode_tree_2.Branch0)
panel_2 = Panel(partition_list)
custom_preview_2 = CustomPreview(Geometry=geometry, Material=explode_tree.Branch0)
area = Area(Geometry=geometry, UseTasks=False)  # -> Area, Centroid
sort_list = SortList(Keys=area.Area, ValuesValuesA=area.Centroid)  # -> Keys, reverse(ValuesValuesA)
sort_list_2 = SortList(Keys=area.Area, ValuesA=geometry)  # -> Keys, reverse(ValuesA)
cross_reference = CrossReference(ListA=area.Centroid, ListB=area.Centroid, CrossMode=5)  # -> graft(ListA), graft(ListB)
partition_list_2 = PartitionList(List=sort_list_2.ValuesA, Size=Slider(2, range=0..10))  # -> simplify(Chunks)
list_item_4 = ListItem(List=sort_list_2.ValuesA, Index=Slider(0, range=0..12), Wrap=True)
point = Point([cross_reference.ListA, cross_reference.ListB])
explode_tree_3 = ExplodeTree(Data=partition_list_2)  # -> Branch0, Branch1, Branch2, Branch3, Branch4, Branch5, Branch6
list_item_5 = ListItem(List=point, Index=0, Wrap=True)  # -> Item, Item1
geometry_2 = Geometry(explode_tree_3.Branch0)
vector_2pt = Vector2Pt(PointA=list_item_5.Item, PointB=list_item_5.Item1, Unitize=False)  # -> Vector, Length
rectanglew_h = CSharpScript(rectangleList=sort_list_2.ValuesA)  # -> Width, Height; inputs rectangleList: list of Rectangle3d
# ---------- rectanglew_h: C# ----------
    var widths = new List<double>();
    var heights = new List<double>();
    
    for( int i = 0; i < rectangleList.Count; ++i )
    {
    
      widths.Add( rectangleList[i].Width );
      heights.Add( rectangleList[i].Height );
    
    }
    
    Width = widths;
    Height = heights;
# ---------- end rectanglew_h ----------
area_2 = Area(Geometry=geometry_2, UseTasks=False)  # -> Area, Centroid
panel_3 = Panel(rectanglew_h.Height)
panel_4 = Panel(rectanglew_h.Width)
vector_display = VectorDisplay(Anchor=list_item_5.Item, Vector=vector_2pt.Vector)
multiplication_4 = Multiplication(A=rectanglew_h.Width, B=0.5)
circle = Circle(Plane=sort_list.ValuesValuesA, Radius=multiplication_4)
